# Grasshopper definition KNK writer v0.1.gh (Grasshopper 0.9.76)
# Copyright: Co-de-iT
# A simple KNK direct code writer

# manual workflow: . set Klick-n-Kut to print through remote spooling:
# Cut > Plotting Defaults > Setup
# 
# . set save directory and perform a cut
# 
# . use HEX-to-ASCII converter to translate spooling file (which is a .tmp) content (http://www.rapidtables.com/convert/number/hex-to-ascii.htm)
# 
# . erase all lines before the IN; instruction
# 
# . save as .txt file
# The KNK MAXX works with HPGL plot language based code, so far I was able to use the basic commands derived from the plot files I have examined but I haven't tried the full range yet, so I'm not sure what works besides the basics I've tried.
# HPGL Plotter command list: http://paulbourke.net/dataformats/hpgl/
# 
# http://www.isoplotec.co.jp/HPGL/eHPGL.htm
# tested (from plot file): IN; - Initialize (I suppose)
# VSXX; - Cut Velocity
# PA; - Start Plot/Cut
# PDXXX,YYY; - Plot Down (x,y) - goes to (x,y) point with plot tool engaged
# PUXXX,YYY; - Plot Up (x,y) - goes to (x,y) point with plot tool disengaged
# @; - end of file
# command list: from: http://forum.make-the-cut.com/discussion/43833/mtc-4-6-2-and-copam-cp-2500-almost-works-but-doesnt-finish
# 
# Initialize: IN;
# Start plot: PA;
# Start cut: PA;
# Reset: IN;
# Move: PU#,#; U#,#;
# Line: PD#,#; D#,#;
# Bezier curve: (BLANK FIELD)
# End: PU;!PG;; @;
# Set origin: PU;PA#,#;PG0;
# Set depth: (BLANK FIELD)
# Set speed: VS#;
# Select pen: SP#;
# Get plotting area: OH;PU;
# Get Head Position: OA;
# single curve
crv = Curve(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)
# multiple curves
pt = Point([Point(5.91944092, 12.01866622, 0), Point(13.04548351, 5.675810256, 0), Point(23.87986788, 18.01308203, 0), Point(28.52285095, 9.323707889, 0), Point(14.80795091, 17.60320589, 0)])
lng = ListLength(List=pt)
divide = DivideCurve(Curve=crv, Count=Slider(1000, range=10..1000), Kinks=False)  # -> Points, Tangents, Parameters
range = Range(Domain="0.1 to 0.3", Steps=Slider(16, range=5..50))
dup = DuplicateData(Data=Slider(0.384, range=0..1), Number=lng, Order=True)
pow = Power(A=range, B=Slider(1.7, range=0.01..3))
# KNK writer
# 
# Convert lines and curves to code for the KNK MAXX plotter/blade cutter. Automatically reads your user directory and finds its way to Desktop. Doc folder or C drive.
# 
# code by Alessio Erioli
# 
# v 0.1
# 
# © Co-de-iT 2017 _ Creative Commons Attribution-NonCommercial-ShareAlike 4.0 International License
# send through cmd.exe: Doing it through the cmd in Windows
# 
# port: COM4
# BAUD rate: 57600
# parity: none
# data bits: 8
# 
# 
# 
# mode COM4 BAUD=57600 PARITY=n DATA=8
# copy KNK_init.txt \\.\COM4
pline = PolyLine(Vertices=divide.Points, Closed=False)
redpline = Reduce(Polyline=pline, Tolerance=Slider(0.005, range=0..1))  # -> Polyline, Reduction
resolution = Slider(0.2, range=0.1..2)
metaball_t = MetaBallTCustom(Points=pt, Charge=dup, Plane=PlaneXY(0, 0, 0), Threshold=pow)
resampling = BooleanToggle(False)
cls = Closed(Curve=metaball_t)  # -> graft(Closed), Periodic
divlength = DivideLength(Curve=metaball_t, Length=resolution)  # -> Points, Tangents, Parameters
pline_2 = PolyLine(Vertices=divlength.Points, Closed=cls.Closed)
filter = StreamFilter(Gate=resampling, Stream0=metaball_t, Stream1=pline_2)
# TO DO:
# 
# . understand unit calibration scale (so far I found 400 empirically from the plot data of known shapes)
# 
# . check if writing single lines of code through the port is ok
# 
# . control speed and force directly from the code (VS command does not really work) AKA bypass manual setting through the KNK display
# 
# . test HPGL plot commands to see what works
# 
# . make a code writer component
# 
# . test if it works on a computer without KNK license
swatch = ColourSwatch(SwatchColor=RGB(38, 38, 38))
swatch_2 = ColourSwatch(SwatchColor=RGB(38, 38, 38))
redpline_2 = Reduce(Polyline=filter, Tolerance=Slider(0.005, range=0..1))  # -> Polyline, Reduction
calibration_scale_for_cm = Panel("400")
explode = Explode(Curve=redpline.Polyline, Recursive=True)  # -> Segments, Vertices
explode_2 = Explode(Curve=redpline_2.Polyline, Recursive=True)  # -> Segments, Vertices
item = ListItem(List=explode_2.Vertices, Index=0, Wrap=True)
preview = CustomPreview(Geometry=redpline.Polyline, Shader=swatch)
cloud = CloudDisplay(Points=explode.Vertices, Colours=swatch, Size=Slider(0.126, range=0..1), SpriteType=0)
preview_2 = CustomPreview(Geometry=redpline_2.Polyline, Shader=swatch_2)
cloud_2 = CloudDisplay(Points=explode_2.Vertices, Colours=swatch_2, Size=Slider(0.126, range=0..1), SpriteType=0)
pdecon = Deconstruct(Point=explode.Vertices)  # -> XComponent, YComponent, ZComponent
pdecon_2 = Deconstruct(Point=explode_2.Vertices)  # -> XComponent, YComponent, ZComponent
pdecon_3 = Deconstruct(Point=item)  # -> XComponent, YComponent, ZComponent
expression = Expression(
    x=pdecon.XComponent,
    y=pdecon.YComponent,
    z=calibration_scale_for_cm,
    Expression="Format(\"PD{0},{1};\", round(x*z), round(y*z))")
expression_2 = Expression(
    x=pdecon_2.XComponent,
    y=pdecon_2.YComponent,
    z=calibration_scale_for_cm,
    Expression="Format(\"PD{0},{1};\", round(x*z), round(y*z))")
expression_3 = Expression(
    x=pdecon_3.XComponent,
    y=pdecon_3.YComponent,
    z=calibration_scale_for_cm,
    Expression="Format(\"PU{0},{1};\", round(x*z), round(y*z))")
txt = Text(expression)
txt_2 = Text(expression_2)
dir_type = ValueList({"desktop": 0, "documents": 1, "GH file path": 2, "C:": 3}, selected="GH file path")
custom_subdir = Panel("data")
file_name_extension = Panel("KNK_rect.txt")
ins = InsertItems(List=txt_2, Item=expression_3, Indices="0", Wrap=True)
c_script = CSharpScript(S=txt)  # -> out, A; inputs S: tree of String
# ---------- c_script: C# ----------
    string sr = "";
    for (int j = 0; j < S.BranchCount;j++){
      for (int i = 0; i < S.Branches[j].Count(); i++){
        sr += S.Branches[j][i];
      }
    }
    A = sr;
# ---------- end c_script ----------
c_script_2 = CSharpScript(S=ins)  # -> out, A; inputs S: tree of String; same code as c_script
dir = CSharpScript(type=dir_type, dir=custom_subdir)  # -> out, A; inputs type: Int32, dir: String
# ---------- dir: C# ----------
    String S = "";
    String root = "";
    String end = "\\";
    switch(type){
      case 0:
        root = Environment.GetFolderPath(Environment.SpecialFolder.Desktop);
        S = "Desktop";
        break;
      case 1:
        root = Environment.GetFolderPath(Environment.SpecialFolder.MyDocuments);
        S = "Documents";
        break;
      case 2:
        GH_Document gh_d = owner.OnPingDocument();

        if (gh_d.IsFilePathDefined)
        {          
          //root = gh_d.FilePath; // this includes the filename, which we don't want
          root = (System.IO.Path.GetDirectoryName(GrasshopperDocument.FilePath));
          S = "GH File path";
        }
        else
        {
          Print("No path defined. Saving to Desktop until then");
          root = Environment.GetFolderPath(Environment.SpecialFolder.Desktop);
          S = "Desktop";
        }
        break;
      case 3:
        root = "C:";
        S = root + end;
        break;
    }
    A = root + end + (dir != null ? (dir + end) : "");
    Component.Message = S;
# ---------- end dir ----------
begin_sequence = Panel("""IN;
VS600;
SP1;
PA;""")
end_sequence = Panel("""PU0,0;
@;""")
begin_sequence_2 = Panel("""IN;
VS600;
SP1;
PA;""")
end_sequence_2 = Panel("""PU0,0;
@;""")
concat = Concatenate(FragmentA=dir.A, FragmentB=file_name_extension)
file = ReadFile(File=concat, PerLineParse=False)
expression_4 = Expression(x=begin_sequence, z=c_script.A, y=end_sequence, Expression="x&z&y")
expression_5 = Expression(x=begin_sequence_2, z=c_script_2.A, y=end_sequence_2, Expression="x&z&y")
panel = Panel(file)
_2_parallel_lines = Panel("""IN;
PA;
VS600;
SP1;
PU4000,0;
PD4000,8000;
VS40;
PU2000,8000;
PD2000,0;
PU0,0;
@;""")
code = ValueList({"sample code": 0, "from file": 1, "single curve": 2, "multiple curves": 3}, selected="sample code")

parity = ValueList({"Even": 0, "Mark": 1, "None": 2, "Odd": 3, "Space": 4}, selected="None")
# port data for KNK MAXX
port = Panel("COM4")
baud_rate = Panel("57600")
bit_data = Panel("8")

filter_2 = StreamFilter(Gate=code, Stream0=_2_parallel_lines, Stream1=panel, Stream2=expression_4, Stream3=expression_5)
send = Button()
knkmaxx = KNKWriter(port=port, B=baud_rate, par=parity, bit=bit_data, code=filter_2, save=send)  # -> out; inputs port: String, B: Int32, par: Int32, bit: Int32, code: String, save: Boolean
# ---------- knkmaxx: C# ----------
    // see https://msdn.microsoft.com/en-us/library/system.io.ports.serialport(v=vs.110).aspx
    // code by Alessio Erioli - (c) Co-de-iT 2017
    String eol = Environment.NewLine;
    Component.Message = "KNK MAXX";
    Component.Name = "KNK Writer";
    Component.NickName = "KNKMAXX";
    Component.Description = "Sends data to the KNK MAXX";

    // set parity
    System.IO.Ports.Parity parity = new System.IO.Ports.Parity();
    switch(par){
      case 0:
        parity = System.IO.Ports.Parity.Even;
        break;
      case 1:
        parity = System.IO.Ports.Parity.Mark;
        break;
      case 2:
        parity = System.IO.Ports.Parity.None;
        break;
      case 3:
        parity = System.IO.Ports.Parity.Odd;
        break;
      case 4:
        parity = System.IO.Ports.Parity.Space;
        break;
      default:
        parity = System.IO.Ports.Parity.None;
        break;
    }

    // initialize port
    System.IO.Ports.SerialPort prt = new System.IO.Ports.SerialPort(port, B, parity, bit);

    if (save){
      prt.Open();
      prt.Write(code);
      prt.Close();
      Print("data sent to KNK!");
      //prt.Open();
      //Sp = port.ReadExisting();
      //prt.Close();
    } else {

      Print("press send button to send data to:" + eol + prt.PortName + " " + prt.BaudRate + " " + prt.Parity + " " + prt.DataBits);
    }
# ---------- end knkmaxx ----------
panel_2 = Panel(knkmaxx)
